# Grasshopper definition grasshopper_to_place_cone.gh (Grasshopper 1.0.8)

number_slider = Slider(80, range=0..1000)
number_slider_2 = Slider(150, range=0..5000)
number_slider_3 = Slider(406.4, range=0..1000)
brep = Brep(<brep referenced from the Rhino model>)
series = Series(Start=0, Step=Slider(200, range=0..1000), Count=Slider(5, range=1..50))
pt = ConstructPoint(XCoordinate=number_slider, YCoordinate=number_slider_2, ZCoordinate=0)
subtraction = Subtraction(A=number_slider_3, B=number_slider)
addition = Addition(A=number_slider_2, B=Slider(157, range=-1000..1000))
rectangle = Rectangle(Plane=PlaneXY(0, 0, 0), XSize=number_slider_3, YSize=Slider(2679.7, range=0..5000), Radius=0)  # -> Rectangle, Length
pt_2 = ConstructPoint(XCoordinate=subtraction, YCoordinate=addition, ZCoordinate=0)
Y = UnitY(Factor=series)
merge = Merge(Data1=pt, Data2=pt_2)
move = Move(Geometry=graft(merge), Motion=Y)  # -> Geometry, Transform
move_2 = Move(Geometry=brep, Motion=move.Geometry)  # -> Geometry, Transform
preview = CustomPreview(Geometry=move_2.Geometry, Material=ColourSwatch(SwatchColor=RGB(54, 91, 186)))
lng = ListLength(List=flatten(move_2.Geometry))
panel = Panel(lng)
